# Grasshopper definition Get site  elevation.gh (Grasshopper 0.9.76)
# plug-ins: Human, HS_Toolbox, Heron, Weaverbird

# ---- group: Input Address
# Step 1: Use address lookup to find the location point
panel = Panel("Swasey Peak")

# ----
usgs = ValueList({"Ortho 1 Foot Imagery": "http://raster.nationalmap.gov/arcgis/rest/services/Orthoimagery/USGS_EROS_Ortho_1Foot/ImageServer/exportImage?", "Ortho Imagery": "http://raster.nationalmap.gov/arcgis/rest/services/Orthoimagery/USGS_EROS_Ortho/ImageServer/exportImage?", "NAIP Imagery": "http://raster.nationalmap.gov/arcgis/rest/services/Orthoimagery/USGS_EROS_Ortho_NAIP/ImageServer/exportImage?", "Land Cover": "http://raster.nationalmap.gov/arcgis/rest/services/LandCover/USGS_EROS_LandCover_NLCD/MapServer/export?", "Land Cover - Conus 01": "http://raster.nationalmap.gov/arcgis/rest/services/LandCover/conus_01/MapServer/export?", "Land Cover - Conus 06": "http://raster.nationalmap.gov/arcgis/rest/services/LandCover/conus_06/MapServer/export?", "Land Cover - Development": "http://raster.nationalmap.gov/arcgis/rest/services/LandCover/Development_0106/MapServer/export?", "Land Cover - Wetland": "http://raster.nationalmap.gov/arcgis/rest/services/LandCover/Wetland_0106/MapServer/export?", "Topo - Scanned Maps": "http://raster.nationalmap.gov/arcgis/rest/services/Scanned_Maps/USGS_EROS_DRG_SCALE/ImageServer/exportImage?"}, selected="Ortho 1 Foot Imagery")

# ---- group: Set a boundry rectangle curve in rhino that contains the area that you want to qury
# Step 2: Manipulate the input boundry crv to identify the region for qury
crv = Curve(<curve referenced from the Rhino model>)

# ----
# Step 3: Deconstruct the box and set resolution for qury.
explode = Explode(Curve=crv, Recursive=True)  # -> Segments, Vertices
restgeocode = ESRIRESTServiceGeocode(Addresses=panel)  # -> Candidates, flatten(Latitude), flatten(Longitude)

y_resolution = Slider(20, range=0..100)
x_resolution = Slider(100, range=0..100)

# ---- group: RH_Input
# Author: Hanshen Sun
# hanshensunw@gmail.com
# Plugin Used: Heron, Weaverbird,
# Meshedit, Human, HSToolbox
pt = Point(Point(0, 0, 0))

pt_2 = Point(Point(0, 0, 0))

# ----
item = ListItem(List=explode.Segments, Index=0, Wrap=True)  # -> Item, Item1, Item2, Item3

# ---- group: Input
pt_3 = Point(Point(0, 0, 0))

pt_4 = Point(Point(0, 0, 0))

# ----
restraster = GetRESTRaster(Boundary=crv, Resolution="2048", FileLocation="C:\Heron\", Prefix="test2", RESTURL=usgs, Run=Toggle(True))  # -> Image, ImageFrame, RESTQuery
ddtoxy = DecimalDegreesToXY(Latitude=restgeocode.Latitude, Longitude=restgeocode.Longitude)

# ---- group: Could have multiple branches because there could be multiple location in the world that has the same name
panel_2 = Panel(restgeocode.Candidates)

# ---- group: Operation
pt_5 = Point(Point(0, 0, 0))

# ----
earthcoordinatestoxy = EarthCoordinatesToXY_GIS(Lat=restgeocode.Latitude, Lon=restgeocode.Longitude)

# ---- group: Operation
pt_6 = Point(Point(0, 0, 0))

# ----
mesh = Mesh(crv)
divide = DivideCurve(Curve=item.Item3, Count=y_resolution, Kinks=False)  # -> reverse(Points), Tangents, Parameters
divide_2 = DivideCurve(Curve=item.Item1, Count=y_resolution, Kinks=False)  # -> Points, Tangents, Parameters

# ---- group: Output
pt_7 = Point(Point(0, 0, 0))

pt_8 = Point(Point(0, 0, 0))

# ----
boundary = BoundarySurfaces(Edges=restraster.ImageFrame)
pt_9 = Point(<point referenced from the Rhino model>)
pttoearthpt = PtToEarthPt(Pt=divide.Points)  # -> Lat, Lon
pttoearthpt_2 = PtToEarthPt(Pt=divide_2.Points)  # -> Lat, Lon

# ---- group: Visualization
pt_10 = Point(Point(0, 0, 0))

pt_11 = Point(Point(0, 0, 0))

# ----
xytodd = XYToDecimalDegrees(XyPoint=ddtoxy)  # -> Latitude, Longitude
surfacemap = SurfaceMapping(Mesh=mesh, Surface=boundary)
xytodd_2 = XYToDecimalDegrees(XyPoint=earthcoordinatestoxy)  # -> Latitude, Longitude

# ---- group: Set True to run
toggle = BooleanToggle(False)

# ----
merge = Merge(Data1=graft(pttoearthpt.Lat), Data2=graft(pttoearthpt_2.Lat))
merge_2 = Merge(Data1=graft(pttoearthpt.Lon), Data2=graft(pttoearthpt_2.Lon))

# ---- group: Visualizing Map
previewmat = CustomPreviewMaterials(Geometry=surfacemap, DiffuseColor=RGB(255, 255, 255), DiffuseBitmap=restraster.Image)

# ----
panel_3 = Panel(xytodd_2.Latitude)
panel_4 = Panel(xytodd.Latitude)
panel_5 = Panel(xytodd_2.Longitude)
panel_6 = Panel(xytodd.Longitude)

# ---- group: Retrieve elevation data in meter/ if didnt work properly just rerun this component
# This Component takes the Lat/Lon of the two endpoints with a specified Y resolution. Using Google elevation Api to retrieve elevation data in Meter.
getelevation = GetElevation_GIS(Latitude=merge, Longitude=merge_2, Resolution=x_resolution, Run=toggle)  # -> Lat, Lon, Elevation

# ----
earthcoordinatestoxy_2 = EarthCoordinatesToXY_GIS(Lat=getelevation.Lat, Lon=getelevation.Lon, Ele=getelevation.Elevation)
bnd = Bounds(Numbers=flatten(getelevation.Elevation))
digit = Slider(1, range=0..10)
remap = RemapNumbers(Value=getelevation.Elevation, Source=bnd, Target=Domain(0, 1))  # -> Mapped, Clipped
del = DelaunayMesh(Points=flatten(earthcoordinatestoxy_2), Plane=PlaneXY(0, 0, 0))
gradient = Gradient(LowerLimit=0, UpperLimit=1, Parameter=remap.Mapped, stops=[0: RGB(26, 81, 163), 1: RGB(122, 242, 92)])
expression = Expression(x=getelevation.Elevation, y=digit, Expression="Round(x,y)")
wblaplace = WeaverbirdsLaplacianSmoothing(MeshCurves=del, Level=1, SmoothNakedEdges=0, Thin=1)
Z = UnitZ(Factor=1)
contour = Contour(Shape=wblaplace, Point=Point(0, 0, 0), Direction=Z, Distance=Slider(10, range=0..10))

# ---- group: Turn on preview for elevation tags
tag = TextTag3D(
    Location=earthcoordinatestoxy_2,
    Text=expression,
    Size=Slider(6, range=0..100),
    Colour=ColourSwatch(SwatchColor=RGB(255, 255, 255)),
    Justification=7)

# ----
dots = DotDisplay(Point=flatten(earthcoordinatestoxy_2), Colour=flatten(gradient), Size=Slider(10, range=0..10))
